# Grasshopper definition Indoor Comfort Map - Visualization.gh (Grasshopper 0.9.76)
# plug-ins: Python Interpreter, ItemSelector

panel = Panel("C:\Users\Christian\Dropbox\Uddannelse\DTU\Projekter\IndoorComfortMap\Images")

honeybee = Honeybee_Honeybee()  # -> Vviiiiiiiiiizzz; plug-in component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
ladybug = Ladybug_Ladybug()  # -> Vviiiiiiiiiizzz; plug-in component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

# ----
# 0 - Geometry
number_slider = Slider(2, range=0..2)
number_slider_2 = Slider(0, range=0..100)
dom = ConstructDomain(DomainStart=number_slider_2, DomainEnd=Slider(3, range=1..5))
dom_2 = ConstructDomain(DomainStart=number_slider_2, DomainEnd=Slider(6, range=1..10))
dom_3 = ConstructDomain(DomainStart=number_slider_2, DomainEnd=Slider(4, range=1..10))
box = DomainBox(Base=PlaneXY(0, 0, 0), X=dom_3, Y=dom_2, Z=dom)
shading = Shading(B=box, D=number_slider)
hb_epcontextsrf = HoneybeeEPContextSurfaces(shdSurfaces=flatten(shading))  # -> HBContext; inputs shdSurfaces: list of Brep, justBoundingBox: Boolean
# ---------- hb_epcontextsrf: Python ----------
"""
prepare shading/context geometries

    Args:
        northVectorOrRotation: A vector that shows North or a number that shows
                               the rotation of the North from the Y axis
        bldgMasses: List of closed Breps as thermal zones.
    Returns:
        report: ...
        thermalZones: Thermal zone's geometries for visualiza
"""

ghenv.Component.Name = 'Honeybee EP context Surfaces'
ghenv.Component.NickName = 'HB_EPContextSrf'
ghenv.Component.Message = 'VER 0.0.63\nJAN_20_2018'
ghenv.Component.IconDisplayMode = ghenv.Component.IconDisplayMode.application
ghenv.Component.Category = "Honeybee"
ghenv.Component.SubCategory = "10 | Energy | Energy"
#compatibleHBVersion = VER 0.0.57\nNOV_04_2016
#compatibleLBVersion = VER 0.0.59\nFEB_01_2015
ghenv.Component.AdditionalHelpFromDocStrings = "2"

import rhinoscriptsyntax as rs
import Rhino as rc
import scriptcontext as sc
import os
import System
import Grasshopper.Kernel as gh
import uuid

tolerance = sc.doc.ModelAbsoluteTolerance
import math


def main(shdSurfaces, EPTransSchedule, meshingSettings, justBoundingBox):
    
    # import the classes
    if sc.sticky.has_key('honeybee_release'):

        try:
            if not sc.sticky['honeybee_release'].isCompatible(ghenv.Component): return -1
            if sc.sticky['honeybee_release'].isInputMissing(ghenv.Component): return -1
        except:
            warning = "You need a newer version of Honeybee to use this compoent." + \
            " Use updateHoneybee component to update userObjects.\n" + \
            "If you have already updated userObjects drag Honeybee_Honeybee component " + \
            "into canvas and try again."
            w = gh.GH_RuntimeMessageLevel.Warning
            ghenv.Component.AddRuntimeMessage(w, warning)
            return -1
        
        # don't customize this part
        hb_EPSrf = sc.sticky["honeybee_EPSurface"]
        hb_EPSHDSurface = sc.sticky["honeybee_EPShdSurface"]
        hb_RADMaterialAUX = sc.sticky["honeybee_RADMaterialAUX"]
        hb_EPObjectsAux = sc.sticky["honeybee_EPObjectsAUX"]()
        HBScheduleList = sc.sticky["honeybee_ScheduleLib"].keys()

        ########################################################################
        #----------------------------------------------------------------------#
        shdBreps = []
        # create bounding box of shading geometries
        if justBoundingBox:
            for brep in shdSurfaces:
                if brep.Faces.Count>1 or not brep.Faces[0].IsPlanar(sc.doc.ModelAbsoluteTolerance):
                    shdBreps.append(brep.GetBoundingBox(True).ToBrep())
                else:
                    shdBreps.append(brep)
        else:
            shdBreps = shdSurfaces
        
        shadingClasses = []
        shadingMeshPreview = []
        
        if meshingSettings == None:
            mp = rc.Geometry.MeshingParameters.Minimal
            mp.SimplePlanes = True
        else:
            mp = meshingSettings
        
        def getRadMaterialName(radMaterial):
            nameStr = radMaterial.split(" ")[2]
            name =  nameStr.split("\n")[0]
            return name
        
        for brepCount, brep in enumerate(shdBreps):
            if brep != None:
                isPlanar = True
                # check planarity
                for face in brep.Faces:
                    if not face.IsPlanar(tolerance):
                        isPlanar = False
                        break
                
                shadingBreps = []
                if not isPlanar:
                    meshArray = rc.Geometry.Mesh.CreateFromBrep(brep, mp)
                    for mesh in meshArray:
                        for meshFace in range(mesh.Faces.Count):
                            vertices = list(mesh.Faces.GetFaceVertices(meshFace))[1:]
                            vertices = vertices + [sc.doc.ModelAbsoluteTolerance]
                            # create the brep from mesh
                            shdBrep = rc.Geometry.Brep.CreateFromCornerPoints(*vertices)
                            shadingBreps.append(shdBrep)
                else:
                    for face in brep.Faces:
                        shadingBreps.append(face.DuplicateFace(False))
                
                for faceCount, shdBrep in enumerate(shadingBreps):
                        thisShading = hb_EPSHDSurface(shdBrep, 1000*brepCount + faceCount, 'shdSrf_' + `brepCount` + '_' + `faceCount` + "_" + str(uuid.uuid4()))
                        
                        # add transmittance schedule if any
                        if EPTransSchedule!=None:
                            schedule= EPTransSchedule.upper()
                            if schedule!=None and not schedule.lower().endswith(".csv") and schedule not in HBScheduleList:
                                msg = "Cannot find " + schedule + " in Honeybee schedule library."
                                print msg
                                ghenv.Component.AddRuntimeMessage(gh.GH_RuntimeMessageLevel.Warning, msg)
                                return -1
                            elif schedule!=None and schedule.lower().endswith(".csv"):
                                # check if csv file is existed
                                if not os.path.isfile(schedule):
                                    msg = "Cannot find the shchedule file: " + schedule
                                    print msg
                                    ghenv.Component.AddRuntimeMessage(gh.GH_RuntimeMessageLevel.Warning, msg)
                                    return -1
                            
                            thisShading.TransmittanceSCH = schedule
                        
                        # add the Rad Material if any
                        if RADMaterial!=None:
                            # if it is just the name of the material make sure it is already defined
                            if len(RADMaterial.split(" ")) == 1:
                                # if the material is not in the library add it to the library
                                if not hb_RADMaterialAUX.isMatrialExistInLibrary(RADMaterial):
                                    warningMsg = "Can't find " + RADMaterial + " in RAD Material Library.\n" + \
                                                "Add the material to the library and try again."
                                    ghenv.Component.AddRuntimeMessage(gh.GH_RuntimeMessageLevel.Warning, warningMsg)
                                    return
                                
                                try:
                                    thisShading.setRADMaterial(RADMaterial)
                                except Exception, e:
                                    print e
                                    warningMsg = "You are using an old version of Honeybee_Honeybee! Update your files and try again."
                                    print warningMsg
                                    ghenv.Component.AddRuntimeMessage(gh.GH_RuntimeMessageLevel.Warning, warningMsg)
                                    return
                                
                                addedToLib = True
                            else:
                                
                                # try to add the material to the library
                                addedToLib, thisShading.RadMaterial = hb_RADMaterialAUX.analyseRadMaterials(RADMaterial, True)
                                
                            if addedToLib==False:
                                warningMsg = "Failed to add " + RADMaterial + " to the Library."
                                ghenv.Component.AddRuntimeMessage(gh.GH_RuntimeMessageLevel.Warning, warningMsg)
                                return
                        
                        # add shading to the list
                        shadingClasses.append(thisShading)
                
        # add to the hive
        hb_hive = sc.sticky["honeybee_Hive"]()
        HBContext  = hb_hive.addToHoneybeeHive(shadingClasses, ghenv.Component)
        return HBContext
        ################################################################################################
    else:
        print "You should first let Honeybee to fly..."
        w = gh.GH_RuntimeMessageLevel.Warning
        ghenv.Component.AddRuntimeMessage(w, "You should first let Honeybee to fly...")
        return -1
        

if _shdSurfaces and _shdSurfaces[0]!=None:
    # add cleaning function
    result= main(_shdSurfaces, EPTransSchedule_, meshingSettings_, justBoundingBox_)
    
    if result != -1: HBContext = result
# ---------- end hb_epcontextsrf ----------

concat = Concatenate(FragmentA="Comfort_Shading_", FragmentB=number_slider)
concat_2 = Concatenate(FragmentA="View_Shading_", FragmentB=number_slider)

# ----
# RUN ME!
# Energy
# Comfort
toggle = BooleanToggle(False)
toggle_2 = BooleanToggle(False)

captureview = Ladybug_CaptureView(fileName=concat, folder=panel, capture=Toggle(False))  # -> imagePath; plug-in component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
captureview_2 = Ladybug_CaptureView(fileName=concat_2, folder=panel, capture=Toggle(False))  # -> imagePath; plug-in component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
fly = Ladybug_fly(inputSliders=number_slider, fly=Toggle(False))  # -> Vviiiiiiiiiizzz; plug-in component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
preview = CustomPreview(Geometry=hb_epcontextsrf, Shader=ColourSwatch(SwatchColor=RGBA(214, 20, 23, 194)))

# ----
# 1 - HB Zone
bldgprograms = Honeybee_bldgPrograms({"Office": 0, "Retail": 1, "MidriseApartment": 2, "PrimarySchool": 3, "SecondarySchool": 4, "SmallHotel": 5, "LargeHotel": 6, "Hospital": 7, "Outpatient": 8, "Warehouse": 9, "SuperMarket": 10, "FullServiceRestaurant": 11, "QuickServiceRestaurant": 12}, selected="Office")
listzoneprograms = Honeybee_ListZonePrograms(bldgProgram=bldgprograms)  # -> OfficeZonePrograms; plug-in component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
list = Honeybee_ItemSelector(
    listzoneprograms,
    {"Office::BreakRoom", "Office::Storage", "Office::Vending", "Office::OpenOffice", "Office::ClosedOffice", "Office::Conference", "Office::PrintRoom", "Office::Restroom", "Office::Elec/MechRoom", "Office::IT_Room", "Office::Stair", "Office::Corridor", "Office::Lobby"}, selected="Office::BreakRoom")
mass2zone = Honeybee_Masses2Zones(zoneMasses=flatten(box), zoneNames="Office Zone", zonePrograms=list, maxRoofAngle=30, createHBZones=toggle_2)  # -> readMe, HBZones; plug-in component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
setepzonecnstr = Honeybee_SetEPZoneConstruction(HBZones=flatten(mass2zone.HBZones))  # -> simplify(modifiedHBZones); plug-in component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

# ----
# 2 - Create Glazing
panel_2 = Panel("threelayerwindow")
number_slider_3 = Slider(0.5, range=0..1)
epwindowmat = Honeybee_EnergyPlusWindowMaterial(name=panel_2, U_Value="1.2", SHGC="0.61", VT="0.65")  # -> EPMaterial; plug-in component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
glzparamlist = Honeybee_GlazingParametersList(northGlzParam=number_slider_3, westGlzParam=0, southGlzParam=number_slider_3, eastGlzParam=0)  # -> glzParamList; plug-in component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
epconstruction = Honeybee_EnergyPlusConstruction(name="Window", layer_1=epwindowmat)  # -> EPConstruction; plug-in component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
glazingcreator = Honeybee_GlazingBasedOnRatio(
    HBObjects=setepzonecnstr,
    glzRatio=glzparamlist,
    breakUpWindow=Toggle(False),
    EPConstructions=epconstruction,
    runIt=toggle_2)  # -> readMe, HBObjWGLZ; plug-in component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

wires = BrepWireframe(Brep=[glazingcreator.HBObjWGLZ, hb_epcontextsrf], Density=-1)
preview_2 = CustomPreview(Geometry=wires, Shader=ColourSwatch(SwatchColor=RGB(3, 0, 0)))

# ----
# 3 - HVAC
hvacsystemslist = Honeybee_HVACSystemsList({"-1. Thermostat Only": -1, "0. Ideal Air Loads": 0, "1. PTAC | Residential": 1, "2. PTHP | Residential": 2, "3. Packaged Single Zone - AC": 3, "4. Packaged Single Zone - HP": 4, "5. Packaged VAV w/ Reheat": 5, "6. Packaged VAV w/ PFP Boxes": 6, "7. VAV w/ Reheat": 7, "8. VAV w/ PFP Boxes": 8, "9. Warm Air Furnace - Gas Fired": 9, "10.Warm Air Furnace - Electric": 10, "11.Fan Coil Units + DOAS": 11, "12.Active Chilled Beams + DOAS": 12, "13.Radiant Floors + DOAS": 13, "14.Radiant Ceilings + DOAS": 14, "15.Heated Floors + VAV Cooling": 15, "16.VRF + DOAS": 16, "17.Ground Source WSHP + DOAS": 17, "18.Ground Source VRF + DOAS": 18}, selected="0. Ideal Air Loads")
hvacsystem = Honeybee_AssignHVACSystem(HBZones=flatten(glazingcreator.HBObjWGLZ), HVACSystems=hvacsystemslist)  # -> readMe, HBZones; plug-in component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

decomposebytype = Honeybee_DecomposeBasedOnType(HBZone=hvacsystem.HBZones)  # -> walls, interiorWalls, airWalls, windows, interiorWindows, skylights, roofs, ceilings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; plug-in component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
preview_3 = CustomPreview(Geometry=decomposebytype.windows, Shader=ColourSwatch(SwatchColor=RGBA(69, 147, 255, 99)))

# ----
# 4 - EPW File
panel_3 = Panel("https://www.energyplus.net/weather-download/europe_wmo_region_6/DEU//DEU_Munich.108660_IWEC/all")
epw_stat = Ladybug_OpenEPWAndSTATWeatherFiles(weatherFileURL=panel_3)  # -> epwFile, statFile; plug-in component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
importepw = Ladybug_ImportEpw(epwFile=epw_stat.epwFile)  # -> readMe, latitude, location, dryBulbTemperature, dewPointTemperature, relativeHumidity, windSpeed, windDirection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; plug-in component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

toggle_3 = BooleanToggle(False)
concat_3 = Concatenate(FragmentA="energy_shade_", FragmentB=number_slider)

# ----
# 5 - Run EnergyPlus
toggle_4 = BooleanToggle(True)
epoutput = Honeybee_GenerateEPOutput(
    zoneEnergyUse=toggle_4,
    zoneGainsAndLosses="False",
    zoneComfortMetrics=toggle_4,
    comfortMapVariables=toggle_4,
    surfaceTempAnalysis=toggle_4)  # -> report, flatten(simulationOutputs); plug-in component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
energysimpar = Honeybee_EnergySimulationPar(timestep=6, solarDistribution="4")  # -> energySimPar; plug-in component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
panel_4 = Panel("C:\Users\Christian\Dropbox\Uddannelse\DTU\Projekter\IndoorComfortMap")
exporttoopenstudio = Honeybee_ExportToOpenStudio(
    epwWeatherFile=epw_stat.epwFile,
    energySimPar=energysimpar,
    HBZones=flatten(hvacsystem.HBZones),
    HBContext=flatten(hb_epcontextsrf),
    simulationOutputs=flatten(epoutput.simulationOutputs),
    writeOSM=toggle_3,
    runSimulation=toggle_3,
    fileName=concat_3,
    workingDir=panel_4)  # -> readMe, osmFileAddress, idfFileAddress, resultFileAddress, eioFileAddress, rddFileAddress, htmlReport, studyFolder, model; plug-in component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

# ----
# 6 - Import Energy Results
number_slider_4 = Slider(2, range=1..2)
concat_4 = Concatenate(FragmentA=panel_4, FragmentC="\", FragmentB=concat_3)
lookupfolder_energyplus = Honeybee_LookupEnergyPlusFolder(studyFolder=concat_4, studyType=number_slider_4, refresh=Button())  # -> readMe, idfFiles, osmFiles, resultFileAddress, scheduleCsvFiles, rddFiles, errFiles, eioFiles, esoFiles, sqlFiles; plug-in component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
readepsrfresult = Honeybee_ReadEPSurfaceResult(resultFileAddress=lookupfolder_energyplus.resultFileAddress)  # -> surfaceIndoorTemp, surfaceOutdoorTemp, port, port_2, port_3, port_4, port_5, port_6, windowTransmissivity, port_7; disabled; plug-in component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
readepresult = Honeybee_ReadEPResult(resultFileAddress=lookupfolder_energyplus.resultFileAddress)  # -> totalThermalLoad, thermalLoadBalance, cooling, heating, electricLight, electricEquip, port, port_2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; plug-in component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
importidf = Honeybee_ImportIdf(idfFile=lookupfolder_energyplus.idfFiles, importEPObjects=Toggle(True))  # -> readMe, HBZones, shadings; disabled; plug-in component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

number_slider_5 = Slider(7, range=0..10)
split = SplitList(List=readepresult.heating, Index=number_slider_5)  # -> ListA, ListB
split_2 = SplitList(List=readepresult.cooling, Index=number_slider_5)  # -> ListA, ListB
ma = MassAddition(Input=split.ListB)  # -> Result, PartialResults
ma_2 = MassAddition(Input=split_2.ListB)  # -> Result, PartialResults
rec = DataRecorder(ma.Result, DataLimit=-10, RecordData=True)
rec_2 = DataRecorder(ma_2.Result, DataLimit=-10, RecordData=True)
panel_5 = Panel(rec)
panel_6 = Panel(rec_2)
int = Integer(Slider(4212, range=0..10000))
data = Data(int)
panel_7 = Panel(data)

# ----
# 7 - Thermal Comfort Map
# Hours Above 0.5 PMV
number_slider_6 = Slider(1.2, range=0..10)
toggle_5 = BooleanToggle(True)
indoorviewfactor = Honeybee_IndoorViewFactorCalculator(
    HBZones=flatten(importidf.HBZones),
    gridSize=Slider(0.3, range=0.3..2),
    distFromFloorOrSrf=flatten(Slider(0.85, range=0..1)),
    parallel=toggle_5,
    buildMesh=toggle_5,
    runIt=toggle)  # -> readMe, port, viewFactorMesh, viewFactorInfo, port_2, testPts, viewMeshFaces, zoneWireFrame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; plug-in component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
clofunction = Ladybug_ClothingFunction(outdoorAirTemperature=importepw.dryBulbTemperature)  # -> readMe, cloValues; plug-in component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
pmvcomfortcalculator = Ladybug_PMVComfortCalculator(
    dryBulbTemperature=readepresult.airTemperature,
    meanRadiantTemperature=readepresult.meanRadTemperature,
    windSpeed=Slider(0.1, range=0..0.1),
    relativeHumidity=readepresult.relativeHumidity,
    metabolicRate=number_slider_6,
    clothingLevel=clofunction.cloValues,
    calcBalanceTemperature=False,
    runIt=toggle)  # -> readMe, port, predictedMeanVote, percentPeopleDissatisfied, standardEffectiveTemperature, port_2, comfortableOrNot, percentOfTimeComfortable, port_3, balanceTemperature; plug-in component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
split_3 = SplitList(List=pmvcomfortcalculator.predictedMeanVote, Index=7)  # -> ListA, ListB
find_pmv_over_0_5 = PythonScript(x=split_3.ListB, y=Slider(0.5, range=0..1))  # -> out, index; inputs x: list
# ---------- find_pmv_over_0_5: Python ----------
index = []
for i in range(len(x)):
    if x[i] > y:
        index.append(i)
# ---------- end find_pmv_over_0_5 ----------
panel_8 = Panel(find_pmv_over_0_5.index)
item = ListItem(List=find_pmv_over_0_5.index, Index=Slider(10, range=0..100), Wrap=True)
pmvcomfrecipe = Honeybee_PMVComfortAnalysisRecipe(
    viewFactorMesh=indoorviewfactor.viewFactorMesh,
    viewFactorInfo=indoorviewfactor.viewFactorInfo,
    epwFile=epw_stat.epwFile,
    srfIndoorTemp=readepsrfresult.surfaceIndoorTemp,
    zoneAirTemp=readepresult.airTemperature,
    zoneRelHumid=readepresult.relativeHumidity,
    zoneAirFlowVol=readepresult.airFlowVolume,
    zoneAirHeatGain=readepresult.airHeatGainRate,
    metabolicRate=Slider(1.2, range=0..10),
    clothingLevel=clofunction.cloValues)  # -> comfRecipe; plug-in component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
microclimatemap = Honeybee_MicroclimateMapAnalysis(comfAnalysisRecipe=pmvcomfrecipe, analysisPeriodOrHOY=panel_7, parallel=Toggle(True), runIt=toggle)  # -> readMe, port, radTempMtx, airTempMtx, operativeTempMtx, adaptComfMtx, degFromTargetMtx, port_2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; plug-in component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
legendpar = Ladybug_LegendParameters(lowBound=Slider(-0.5, range=-0.5..3), highBound=Slider(1, range=-0.5..3))  # -> legendPar; plug-in component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
visualizemicroclimate = Honeybee_VisualizeMicroclimateMap(
    comfResultsMtx=microclimatemap.degFromTargetMtx,
    viewFactorMesh=flatten(indoorviewfactor.viewFactorMesh),
    legendPar=legendpar,
    runIt=toggle)  # -> readMe, port, resultMesh, legend, legendBasePt, port_2, resultValues, resultColors; plug-in component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

preview_4 = CustomPreview(Geometry=[visualizemicroclimate.legend, visualizemicroclimate.resultMesh], Shader=ColourSwatch(SwatchColor=RGB(0, 0, 0)))

# ==== cluster Shading
B = ClusterInput()
debrep = DeconstructBrep(Brep=B)  # -> Faces, Edges, Vertices
item = ListItem(List=debrep.Edges, Index=Slider(4, range=0..11), Wrap=True)
D = ClusterInput()
offset = Offset(Curve=item, Distance=expr("-x", D), Plane=PlaneXY(0, 0, 0), Corners=1)
end = EndPoints(Curve=offset)  # -> Start, End
end_2 = EndPoints(Curve=item)  # -> Start, End
ln = Line(StartPoint=end_2.Start, EndPoint=end.Start)
ln_2 = Line(StartPoint=end_2.End, EndPoint=end.End)
boundary = BoundarySurfaces(Edges=flatten([item, offset, ln, ln_2]))
S = ClusterOutput(boundary)
