# Grasshopper definition Run-off 3D.gh (Grasshopper 0.9.76)
# plug-ins: MeshEdit Components, Python Interpreter, Human

# ----
# 0 - Livestock Setup
# Python and SSH
panel = Panel("")
ssh_connection = LivestockSSHConnection()  # -> readMe
#   port IP: IP Address for SSH connection
#   port Port: Port for SSH connection
#   port Username: Username for SSH connection
#   port Password: Password for SSH connection
#   port readMe: In case of any errors, it will be shown here.
# ---------- ssh_connection: Python ----------
from livestock.components.misc import SSHConnection

comp = SSHConnection(ghenv)
comp.config()
comp.run_checks(str(IP), str(Port), str(Username), str(Password))
comp.run()
# ---------- end ssh_connection ----------
python_executor = LivestockPythonExecutor(PythonPath=panel)  # -> readMe
#   port PythonPath: Path to python.exe
#   port readMe: In case of any errors, it will be shown here.
# ---------- python_executor: Python ----------
from livestock.components.misc import PythonExecutor

comp = PythonExecutor(ghenv)
comp.config()
comp.run_checks(str(PythonPath))
comp.run()
# ---------- end python_executor ----------
panel_2 = Panel(ssh_connection)
panel_3 = Panel(python_executor)

# ----
# 1 - GEOMETRY
number_slider = Slider(39, range=15..100)
custom_mesh_settings = SettingsCustom(
    StitchSeams=True,
    SimplePlanes=False,
    Refine=True,
    MinCount=number_slider,
    MaxCount=400,
    AspectRatio=20,
    MaxDistance=0,
    MaxAngle=20,
    MinEdge=0,
    MaxEdge=0)
srf = Surface(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)
mesh = MeshBrep(Brep=srf, Settings=custom_mesh_settings)

# ----
# RUN ME!
write_case = BooleanToggle(False)
solve_case = BooleanToggle(False)

# ----
# Pick Face on the Slope
explode = MeshExplode(Mesh=mesh, Interpolate=False)
item = ListItem(List=explode, Index=0, Wrap=True)

# ----
# Make HoneyBee Surface
panel_4 = Panel("context")
callfromlibrary = Honeybee_CallFromRadianceLibrary(keywords=panel_4)  # -> materials; plug-in component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
createhbsrfs = Honeybee_createHBSrfs(geometry=item, RADMaterial=callfromlibrary)  # -> readMe, simplify(HBSurface); plug-in component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

write_daylight = BooleanToggle(False)
solve_daylight = BooleanToggle(False)

ladybug = Ladybug_Ladybug()  # -> Vviiiiiiiiiizzz; plug-in component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
honeybee = Honeybee_Honeybee()  # -> Vviiiiiiiiiizzz; plug-in component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

# ----
# Grid
number_slider_2 = Slider(0.25, range=0..1)
area = MeshArea(Mesh=item)  # -> Area, Centroid
Z = UnitZ(Factor=number_slider_2)
# 3a - Global Radiation
# With Ladybug Tools
move = Move(Geometry=area.Centroid, Motion=graft(Z))  # -> Geometry, Transform

# ----
# Daylight Recipe
number_slider_3 = Slider(1, range=1..2)
dsparameters = Honeybee_DSParameters(outputUnits=number_slider_3, dgp_imageSize=250, onlyRunGlareAnalysis=True)  # -> DSParameters; plug-in component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
radparameters = Honeybee_RADParameters(quality=0)  # -> readMe, radParameters; plug-in component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
path = FilePath("C:\Users\Christian\Dropbox\Uddannelse\DTU\Diverse\EPW_WeatherData\CPH_DRY_2013CST.epw")
annualdaylightsimulation = Honeybee_AnnualDaylightSimulation(
    epwWeatherFile=path,
    testPoints=move.Geometry,
    testMesh=item,
    radParameters=radparameters.radParameters,
    DSParameters=dsparameters)  # -> analysisRecipe; plug-in component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

# ----
# Retention Curve
number_slider_4 = Slider(0, range=0..5)
cmf_retention_curve = LivestockCMFRetentionCurve(SoilIndex=number_slider_4, K_sat=Slider(0.1, range=0.1..1))  # -> readMe, Units, CurveValues, RetentionCurve
#   port SoilIndex: Index for choosing soil type. Index from 0-5. Default is set to 0, which is the default CMF retention curve.
#   port K_sat: Saturated conductivity in m/day
#   port Phi: Porosity in m3/m3
#   port Alpha: Inverse of water entry potential in 1/cm
#   port N: Pore size distribution parameter is unitless
#   port M: VanGenuchten m (if negative, 1-1/n is used) is unitless
#   port L: Mualem tortoisivity is unitless
#   port readMe: In case of any errors, it will be shown here.
#   port Units: Shows the units of the curve values
#   port CurveValues: Chosen curve properties values
#   port RetentionCurve: Livestock Retention Curve
# ---------- cmf_retention_curve: Python ----------
from livestock.components.comp_cmf import CMFRetentionCurve

comp = CMFRetentionCurve(ghenv)
comp.config()
comp.run_checks(SoilIndex, K_sat, Phi, Alpha, N, M, L)
comp.run()

Units = comp.units
CurveValues = comp.property.values()
RetentionCurve = comp.results
# ---------- end cmf_retention_curve ----------
panel_5 = Panel(cmf_retention_curve.CurveValues)
panel_6 = Panel(cmf_retention_curve.Units)

# ----
# Soil Layers
number_slider_5 = Slider(0, range=0..2)
series = Series(Start=Slider(0.1, range=0..1), Step=number_slider_5, Count=Slider(1, range=1..10))

# ----
# Retention Curve
number_slider_6 = Slider(0, range=0..5)
cmf_retention_curve_2 = LivestockCMFRetentionCurve(SoilIndex=number_slider_6, K_sat=Slider(0.1, range=0.1..1))  # -> readMe, Units, CurveValues, RetentionCurve; same code as cmf_retention_curve
panel_7 = Panel(cmf_retention_curve_2.CurveValues)
panel_8 = Panel(cmf_retention_curve_2.Units)

# ----
# Soil Layers
number_slider_7 = Slider(0, range=0..2)
series_2 = Series(Start=Slider(0.1, range=0..1), Step=number_slider_7, Count=Slider(1, range=1..10))

# ----
# Surface Properties
number_slider_8 = Slider(3, range=0..5)
cmf_vegetation_properties = LivestockCMFVegetationProperties(Property=number_slider_8)  # -> readMe, Units, VegetationValues, VegetationProperties
#   port Property: 0-1 grasses. 2-6 soils
#   port readMe: In case of any errors, it will be shown here.
#   port Units: Shows the units of the surface values
#   port VegetationValues: Chosen surface properties values
#   port VegetationProperties: Livestock surface properties data
# ---------- cmf_vegetation_properties: Python ----------
from livestock.components.comp_cmf import CMFVegetationProperties

comp = CMFVegetationProperties(ghenv)
comp.config()
comp.run_checks(Property)
comp.run()

Units = comp.units
VegetationValues = comp.property.values()
VegetationProperties = comp.results
# ---------- end cmf_vegetation_properties ----------
panel_9 = Panel(cmf_vegetation_properties.VegetationValues)
panel_10 = Panel(cmf_vegetation_properties.Units)

# ----
# Surface Properties
number_slider_9 = Slider(3, range=0..5)
cmf_vegetation_properties_2 = LivestockCMFVegetationProperties(Property=number_slider_9)  # -> readMe, Units, VegetationValues, VegetationProperties; same code as cmf_vegetation_properties
panel_11 = Panel(cmf_vegetation_properties_2.VegetationValues)
panel_12 = Panel(cmf_vegetation_properties_2.Units)

# ----
# Ladybug Tools - Location
number_slider_10 = Slider(12, range=0..100)
constructlocation = Ladybug_ConstructLocation(locationName="Copenhagen", latitude=number_slider_10, longitude=Slider(55, range=0..100), timeZone=0, elevation=0)  # -> location; plug-in component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

# ----
# Face Indices
panel_13 = Panel("""0
6
35""")

# ----
# 2b - Ground
number_slider_11 = Slider(5, range=0..10)
cmf_ground = LivestockCMFGround(
    Layers=series_2,
    RetentionCurve=cmf_retention_curve_2.RetentionCurve,
    VegetationProperties=cmf_vegetation_properties_2.VegetationProperties,
    SaturatedDepth=Slider(5, range=1..10),
    SurfaceWaterVolume=number_slider_11,
    FaceIndices=panel_13,
    ETMethod=Slider(0, range=0..2),
    SurfaceRunOffMethod=Slider(1, range=0..1))  # -> readMe, Ground; inputs Layers: list, FaceIndices: list
#   port Layers: Soil layers to add to the mesh in m
#   port RetentionCurve: Livestock CMF Retention Curve
#   port VegetationProperties: Input from Livestock CMF Vegetation Properties
#   port SaturatedDepth: Initial saturated depth in m. It is depth where the groundwater is located - Default is set to 3m
#   port SurfaceWaterVolume: Initial surface water volume in m3. - Default is set to 0 m3
#   port FaceIndices: List of face indices, on where the ground properties are applied.
#   port ETMethod: Set method to calculate evapotranspiration. 0: No evapotranspiration 1: Penman-Monteith 2: Shuttleworth-Wallace Default is set to no evapotranspiration
#   port Manning: Set Manning roughness. If not set CMF calculates it from the above given values.
#   port PuddleDepth: Set puddle depth. Puddle depth is the height were run-off begins. Default is set to 0.01m
#   port SurfaceRunOffMethod: Set the method for computing the surface run-off. 0 - Kinematic Wave. 1 - Diffusive Wave. Default is set 0 - Kinematic Wave.
#   port readMe: In case of any errors, it will be shown here.
#   port Ground: Livestock Ground Data Class
# ---------- cmf_ground: Python ----------
from livestock.components.comp_cmf import CMFGround

comp = CMFGround(ghenv)
comp.config()
comp.run_checks(Layers, RetentionCurve, VegetationProperties, SaturatedDepth, 
                SurfaceWaterVolume, FaceIndices, ETMethod, Manning, PuddleDepth, 
                SurfaceRunOffMethod)
comp.run()

Ground = comp.results
# ---------- end cmf_ground ----------

# ----
# Face Indices
demesh = DeconstructMesh(Mesh=mesh)  # -> Vertices, Faces, Colours, Normals
lng = ListLength(List=demesh.Faces)
series_3 = Series(Start=0, Step=1, Count=lng)
cull_i = CullIndex(List=series_3, Indices=panel_13, Wrap=True)
panel_14 = Panel(cull_i)

# ----
# 2a - Ground
number_slider_12 = Slider(1, range=0..1)
cmf_ground_2 = LivestockCMFGround(
    Layers=series,
    RetentionCurve=cmf_retention_curve.RetentionCurve,
    VegetationProperties=cmf_vegetation_properties.VegetationProperties,
    SaturatedDepth=Slider(5, range=1..10),
    FaceIndices=panel_14,
    ETMethod=Slider(0, range=0..2),
    SurfaceRunOffMethod=number_slider_12)  # -> readMe, Ground; inputs Layers: list, FaceIndices: list; same code as cmf_ground

merge = Merge(Data1=cmf_ground_2.Ground, Data2=cmf_ground.Ground)  # -> flatten(Result)

# ----
# Solver Settings & Outputs
number_slider_13 = Slider(1, range=0..1)
number_slider_14 = Slider(1, range=1..8760)
toggle = BooleanToggle(True)
cmf_outputs = LivestockCMFOutputs(Evapotranspiration=Toggle(False), SurfaceWaterVolume=toggle, SurfaceWaterFlux=toggle)  # -> readMe, ChosenOutputs, Outputs
#   port Evapotranspiration: Cell evaporation - default is set to True
#   port SurfaceWaterVolume: Cell surface water - default is set to False
#   port SurfaceWaterFlux: Cell surface water flux - default is set to False
#   port HeatFlux: Cell surface heat flux - default is set to False
#   port AerodynamicResistance: Cell aerodynamic resistance - default is set to False
#   port VolumetricFlux: Soil layer volumetric flux vectors - default is set to False
#   port Potential: Soil layer total potential (Psi_tot = Psi_M + Psi_G - default is set to False
#   port Theta: Soil layer volumetric water content of the layer - default is set to False
#   port Volume: Soil layer volume of water in the layer - default is set to False
#   port Wetness: Soil layer wetness of the soil (V_volume/V_pores) - default is set to False
#   port readMe: In case of any errors, it will be shown here.
#   port ChosenOutputs: Shows the chosen outputs
#   port Outputs: Livestock Output Data
# ---------- cmf_outputs: Python ----------
from livestock.components.comp_cmf import CMFOutputs

comp = CMFOutputs(ghenv)
comp.config()
comp.run_checks(Evapotranspiration, SurfaceWaterVolume, SurfaceWaterFlux, 
                HeatFlux, AerodynamicResistance, VolumetricFlux, Potential, 
                Theta, Volume, Wetness)
comp.run()

ChosenOutputs = comp.output_dict.items()
Outputs = comp.results
# ---------- end cmf_outputs ----------
cmf_solver_settings = LivestockCMFSolverSettings(AnalysisLength=number_slider_14, TimeStep="0.00027", SolverTolerance="1e-04", Verbosity=number_slider_13)  # -> readMe, SolverSettings
#   port AnalysisLength: Total length of the simulation in hours - default is set to 24 hours.
#   port TimeStep: Size of each time step in hours - e.g. 1/60 equals time steps of 1 min and 24 is a time step of one day. Default is 1 hour
#   port SolverTolerance: Solver tolerance - Default is 1e-8
#   port Verbosity: Sets the verbosity of the print statement during runtime - Default is 1. 0 - Prints only at start and end of simulation. 1 - Prints at every time step.
#   port readMe: In case of any errors, it will be shown here.
#   port SolverSettings: Livestock Solver Settings
# ---------- cmf_solver_settings: Python ----------
from livestock.components.comp_cmf import CMFSolverSettings

comp = CMFSolverSettings(ghenv)
comp.config()
comp.run_checks(AnalysisLength, TimeStep, SolverTolerance, Verbosity)
comp.run()

SolverSettings = comp.results
# ---------- end cmf_solver_settings ----------

# ----
# Load Weather Data
panel_15 = Panel("C:\Users\Christian\Dropbox\Uddannelse\DTU\11. semester - Speciale\Data\ProcessedData")
panel_16 = Panel("""/temp.txt
/windspeed.txt
/relhum.txt
/cloudcover.txt
/rain.txt
/groundtemp.txt""")
concat = Concatenate(FragmentA=panel_15, FragmentB=panel_16)
file = ReadFile(File=concat, PerLineParse=True)
cull_i_2 = CullIndex(List=file, Indices=-1, Wrap=True)
split = SplitList(List=file, Index=number_slider_14)  # -> ListA, ListB
path_mapper = PathMapper(split.ListA, source="{A;B;C}", target="{A;B}")

faceb = FaceBoundaries(Mesh=mesh)
Z_2 = UnitZ(Factor=series)
Z_3 = UnitZ(Factor=expr("-x", series))  # -> graft(UnitVector)
# Visualize Geometry
extr = Extrude(Base=faceb, Direction=Z_2)
move_2 = Move(Geometry=extr, Motion=Z_3)  # -> Geometry, Transform
wires = BrepWireframe(Brep=move_2.Geometry, Density=-1)  # -> simplify(Wireframe)
facen = FaceNormals(Mesh=mesh)  # -> Centers, Normals

# ----
# Display Results
toggle_2 = BooleanToggle(True)

# ----
# Time
number_slider_15 = Slider(10, range=0..10)

swatch = ColourSwatch(SwatchColor=RGB(0, 0, 0))
preview = CustomPreview(Geometry=wires, Shader=swatch)
preview_2 = CustomPreview(Geometry=mesh, Shader=ColourSwatch(SwatchColor=RGB(203, 162, 125)))
points = PointList(Points=facen.Centers)
preview_3 = CustomPreview(Geometry=faceb, Shader=swatch)

panel_17 = Panel("""Surface Run-off
After: """)
int = Integer(number_slider_15)
concat_2 = Concatenate(FragmentA=panel_17, FragmentB=int, FragmentC=" seconds")
texttoscreen = RenderTextToScreen(Text=concat_2, Location="100, 100, 100", Size=Slider(15, range=10..20), Color=RGB(0, 0, 0), m_scWithvp=False)

# ----
# Lookup Results
panel_18 = Panel("\")

# ----
# 3 - Weather
number_slider_16 = Slider(0, range=0..10)
dup = DuplicateData(Data=number_slider_16, Number=number_slider_14, Order=True)
bang = ExplodeTree(Data=path_mapper)  # -> Branch0, Branch1, Branch2, Branch3, Branch4, Branch5

# ----
# Run Daylight
number_slider_17 = Slider(4, range=1..8)

# ----
# Visualize Daylight Results
number_slider_18 = Slider(1, range=0..23)
gradientlibrary = Ladybug_GradientLibrary(gradIndex=number_slider_18)  # -> customColors; plug-in component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
hoy = LadybugPlus_CalculateHOY(month=Slider(4, range=1..12), day=Slider(1, range=1..31), hour=Slider(16, range=1..24), minute=0)  # -> hoy, doy, date; plug-in component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
legendpar = Ladybug_LegendParameters(customColors=flatten(gradientlibrary))  # -> legendPar; plug-in component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
concat_3 = Concatenate(FragmentA="Solar Radiation", FragmentB=hoy.date)

# ----
# 4 - Solve
panel_19 = Panel("run_off_3d_v0")

concat_4 = Concatenate(FragmentA="C:\livestock\projects", FragmentB=panel_18, FragmentC=panel_19)
lookupfolder_daylighting = Honeybee_LookupDaylightingFolder(studyFolder=concat_4, studyType=Slider(5, range=1..5), refresh=Button())  # -> analysisType, resultsUnit, resultFiles, ptsFiles, hdrFiles, imageFiles, iesFiles, epwFile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; plug-in component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
importpts = Honeybee_ImportPtsFile(ptsFileAddress=lookupfolder_daylighting.ptsFiles)  # -> points, vectors; plug-in component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
readallthedshourlyresults = Honeybee_ReadAllTheHourlyResultsFromAnnualDaylightStudy(illFilesAddress=lookupfolder_daylighting.resultFiles, testPoints=importpts.points)  # -> iIllumLevelsNoDynamicSHD, iIllumLevelsDynamicSHDGroupI, iIllumLevelsDynamicSHDGroupII, iIlluminanceBasedOnOccupancy, shadingGroupInEffect; plug-in component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
path_mapper_2 = PathMapper(readallthedshourlyresults.iIllumLevelsNoDynamicSHD, source="{A;B}", target="{0;1}")

cmf_weather = LivestockCMFWeather(
    Temperature=bang.Branch0,
    WindSpeed=bang.Branch1,
    RelativeHumidity=bang.Branch2,
    CloudCover=bang.Branch3,
    GlobalRadiation=path_mapper_2,
    Rain=dup,
    GroundTemperature=bang.Branch5,
    Location=constructlocation,
    MeshFaceCount=lng)  # -> readMe, Weather; inputs Temperature: tree, WindSpeed: tree, RelativeHumidity: tree, CloudCover: tree, GlobalRadiation: tree, Rain: tree, GroundTemperature: tree
#   port Temperature: Temperature in C. Either a list or a tree where the number of branches is equal to the number of mesh faces.
#   port WindSpeed: Wind speed in m/s. Either a list or a tree where the number of branches is equal to the number of mesh faces.
#   port RelativeHumidity: Relative humidity in %. Either a list or a tree where the number of branches is equal to the number of mesh faces.
#   port CloudCover: Cloud cover, unitless between 0 and 1. Either a list or a tree where the number of branches is equal to the number of mesh faces.
#   port GlobalRadiation: Global Radiation in W/m2. Either a list or a tree where the number of branches is equal to the number of mesh faces.
#   port Rain: Horizontal precipitation in mm/h. Either a list or a tree where the number of branches is equal to the number of mesh faces.
#   port GroundTemperature: Ground temperature in C. Either a list or a tree where the number of branches is equal to the number of mesh faces.
#   port Location: A Ladybug Tools Location
#   port MeshFaceCount: Number of faces in the ground mesh
#   port readMe: In case of any errors, it will be shown here.
#   port Weather: Livestock Weather Data Class
# ---------- cmf_weather: Python ----------
from livestock.components.comp_cmf import CMFWeather

comp = CMFWeather(ghenv)
comp.config()
comp.run_checks(Temperature, WindSpeed, RelativeHumidity, CloudCover, GlobalRadiation, Rain, GroundTemperature, Location, MeshFaceCount)
comp.run()

Weather = comp.results
# ---------- end cmf_weather ----------
panel_20 = Panel(cmf_weather.readMe)

rundaylightanalysis = Honeybee_RunDaylightSimulation(
    HBObjects=flatten(createhbsrfs.HBSurface),
    analysisRecipe=annualdaylightsimulation,
    writeRad=write_daylight,
    runRad=solve_daylight,
    numOfCPUs=number_slider_17,
    workingDir="C:\livestock\projects",
    radFileName=panel_19,
    overwriteResults=True)  # -> readMe, analysisType, resultsUnit, results, testPts, annual_analysis_files, radGeoFile, studyFolder, done; disabled; plug-in component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
panel_21 = Panel(rundaylightanalysis.readMe)

readdshourlyresults = Honeybee_ReadHourlyResultsFromAnnualDaylightStudy(illFilesAddress=lookupfolder_daylighting.resultFiles, testPoints=importpts.points, HOY=hoy.hoy)  # -> iIllumLevelsNoDynamicSHD, iIllumLevelsDynamicSHDGroupI, iIllumLevelsDynamicSHDGroupII, iIlluminanceBasedOnOccupancy, shadingGroupInEffect; plug-in component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
recolormesh = Ladybug_RecolorMesh(
    analysisResult=readdshourlyresults.iIllumLevelsNoDynamicSHD,
    inputMesh=item,
    legendPar=legendpar,
    analysisTitle=concat_3,
    legendTitle="W/m2")  # -> readMe, newMesh, newLegend, legendBasePt, meshColors, legendColors; plug-in component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
preview_4 = CustomPreview(Geometry=recolormesh.newMesh, Shader=recolormesh.meshColors)
preview_5 = CustomPreview(Geometry=recolormesh.newLegend, Shader=ColourSwatch(SwatchColor=RGB(0, 0, 0)))

concat_5 = Concatenate(FragmentA=panel_19, FragmentB="/CMF")

cmf_solve = LivestockCMFSolve(
    Mesh=mesh,
    Ground=merge,
    Weather=cmf_weather.Weather,
    SolverSettings=cmf_solver_settings.SolverSettings,
    Folder="C:\livestock\projects",
    CaseName=concat_5,
    Outputs=cmf_outputs.Outputs,
    Write=write_case,
    Run=solve_case)  # -> readMe, ResultPath; inputs Ground: list, Trees: list, BoundaryConditions: list
#   port Mesh: Topography as a mesh
#   port Ground: Input from Livestock CMF Ground
#   port Weather: Input from Livestock CMF Weather
#   port Trees: Input from Livestock CMF Tree
#   port Stream: Input from Livestock CMF Stream
#   port BoundaryConditions: Input from Livestock CMF Boundary Condition
#   port SolverSettings: Input from Livestock CMF Solver Settings
#   port Folder: Path to folder. Default is Desktop
#   port CaseName: Case name as string. Default is CMF
#   port Outputs: Connect Livestock Outputs
#   port Write: Boolean to write files
#   port Overwrite: If True excising case will be overwritten. Default is set to True
#   port Run: Boolean to run analysis Analysis will be ran through SSH. Configure the connection with Livestock SSH
#   port readMe: In case of any errors, it will be shown here.
#   port ResultPath: Path to result files
# ---------- cmf_solve: Python ----------
from livestock.components.comp_cmf import CMFSolve

comp = CMFSolve(ghenv)
comp.config()
comp.run_checks(Mesh, Ground, Weather, Trees, Stream, BoundaryConditions, 
                SolverSettings, Folder, CaseName, Outputs, Write, Overwrite, Run)
comp.run(ghdoc)

ResultPath = comp.case_path
# ---------- end cmf_solve ----------
panel_22 = Panel(cmf_solve.readMe)

# ----
# Create Volumes
panel_23 = Panel("/")
concat_6 = Concatenate(FragmentA="C:\livestock\projects", FragmentB=panel_23, FragmentC=concat_5)
cmf_results = LivestockCMFResults(ResultFolder=concat_6, FetchResult=Slider(1, range=0..1), Run=Toggle(False))  # -> readMe, Units, Values, CSVPath
#   port ResultFolder: Path to result folder. Accepts output from Livestock Solve.
#   port FetchResult: Choose which result should be loaded: 0 - Evapotranspiration 1 - Surface water volume 2 - Surface water flux 3 - Heat flux 4 - Aerodynamic resistance 5 - Soil layer water flux 6 - Soil layer potential 7 - Soil layer theta 8 - Soil layer volume 9 - Soil layer wetness
#   port SaveCSV: Save the values as a csv file - Default is set to False
#   port Run: Run component
#   port readMe: In case of any errors, it will be shown here.
#   port Units: Shows the units of the results
#   port Values: List with chosen result values
#   port CSVPath: Path to csv file.
# ---------- cmf_results: Python ----------
from livestock.components.comp_cmf import CMFResults

comp = CMFResults(ghenv)
comp.config()
comp.run_checks(ResultFolder, FetchResult, SaveCSV, Run)
comp.run()

Units = comp.unit
Values = comp.results
# ---------- end cmf_results ----------
item_2 = ListItem(List=cmf_results.Values, Index=number_slider_15, Wrap=True)

# ----
# Calculate Surface Run-Off
toggle_3 = BooleanToggle(False)
cmf_surface_flux_result = LivestockCMFSurfaceFluxResult(ResultFolder=concat_6, Mesh=mesh, SaveResult=toggle_2, Write=toggle_3, Run=Toggle(False))  # -> readMe, Unit, SurfaceFluxVectors, CSVPath
#   port ResultFolder: Path to result folder. Accepts output from Livestock Solve
#   port Mesh: Mesh of the case
#   port IncludeRunOff: Include surface run-off into the surface flux vector? Default is set to True
#   port IncludeRain: Include rain into the surface flux vector? Default is False.
#   port IncludeEvapotranspiration: Include evapotranspiration into the surface flux vector? Default is set to False
#   port IncludeInfiltration: Include infiltration into the surface flux vector? Default is set to False
#   port SaveResult: Save the values as a text file - Default is set to False
#   port Write: Write component files
#   port Run: Run component
#   port readMe: In case of any errors, it will be shown here.
#   port Unit: Shows the units of the results
#   port SurfaceFluxVectors: Tree with the surface flux vectors
#   port CSVPath: Path to csv file.
# ---------- cmf_surface_flux_result: Python ----------
from livestock.components.comp_cmf import CMFSurfaceFluxResult

comp = CMFSurfaceFluxResult(ghenv)
comp.config()
comp.run_checks(ResultFolder, Mesh, IncludeRunOff, IncludeRain, 
                IncludeEvapotranspiration, IncludeInfiltration, SaveResult, 
                Write, Run)
comp.run()


Unit = comp.unit
SurfaceFluxVectors = comp.results
ResultPath = comp.result_path
# ---------- end cmf_surface_flux_result ----------
panel_24 = Panel(cmf_surface_flux_result.readMe)

# ----
# Display Flux Vectors
panel_25 = Panel("1.16*10e-5")
explode_2 = MeshExplode(Mesh=mesh, Interpolate=False)
area_2 = Area(Geometry=explode_2)  # -> Area, Centroid
item_3 = ListItem(List=cmf_surface_flux_result.SurfaceFluxVectors, Index=number_slider_15, Wrap=True)
multiplication = Multiplication(A=item_3, B=panel_25)
vdisex = VectorDisplayEx(Point=graft(area_2.Centroid), Vector=multiplication, Colour=RGB(0, 0, 0), Width=2)

division = Division(A=flatten(item_2), B=area_2.Area)
faceb_2 = FaceBoundaries(Mesh=explode_2)  # -> flatten(Boundaries)
Z_4 = UnitZ(Factor=division)
extr_2 = Extrude(Base=faceb_2, Direction=Z_4)
plane_water_surface = PlaneWaterSurface(L=faceb_2, P=faceb_2, T=Z_4, A=Z_4, C=srf)
cap = CapHoles(Brep=extr_2)  # disabled
preview_6 = CustomPreview(Geometry=plane_water_surface, Shader=ColourSwatch(SwatchColor=RGBA(47, 142, 255, 183)))

# ==== cluster PlaneWaterSurface
P = ClusterInput()
pcen = PolygonCenter(Polyline=P)  # -> CenterV, CenterE, CenterA
xy = XYPlane(Origin=pcen.CenterV)
A = ClusterInput()
T = ClusterInput()
larger = LargerThan(FirstNumber=A, SecondNumber=0)  # -> LargerThan, OrEqualTo
move = Move(Geometry=xy, Motion=T)  # -> Geometry, Transform
L = ClusterInput()
cull = CullPattern(List=L, CullPattern=larger.LargerThan)
cull_2 = CullPattern(List=move.Geometry, CullPattern=larger.LargerThan)
project = Project(Geometry=cull, Plane=cull_2)  # -> Geometry, Transform
Z = UnitZ(Factor=Slider(-3, range=-3..0))
extr = Extrude(Base=project.Geometry, Direction=Z)
C = ClusterInput()
cap = CapHoles(Brep=extr)
split = SplitBrep(Brep=cap, Cutter=C)
split_2 = SplitList(List=split, Index=1)  # -> ListA, ListB
A_2 = ClusterOutput(split_2.ListA)
